# Dynamo graph CreateLevels_Design.dyn (Dynamo 2.19.3.6543)
# Creates 52 Revit Levels using a single native DesignScript code block to generate elevations and names, then Level.ByElevationAndName to build the levels. No Python and no separate input nodes - edit the literal values at the top of the code block (count, floorHeight, baseElevation, prefix) to customize. Elevation/height values are in Revit internal units (decimal feet) regardless of the project's display units.

# group: PROCESS
# DesignScript code block computes elevations/names, then Level.ByElevationAndName creates each Level (Auto replication = one call per pair). List.Count confirms 52.
# note: Create 52 Levels  -  Revit 2027 (pure DesignScript, no Python, no input nodes)
designscript_count_floorheight = CodeBlock()  # "DesignScript: count / floorHeight / baseElevation / prefix"; graph input
# ---------- designscript_count_floorheight.designscript (15 lines) ----------
count = 52;
floorHeight = 13.0;
baseElevation = 0.0;
prefix = "Level ";
indices = 0..(count - 1);
elevations = baseElevation + indices * floorHeight;
names = [Imperative](count, prefix)
{
    result = {};
    for (i in 0..(count - 1))
    {
        result[i] = prefix + ToString(i + 1);
    }
    return = result;
};
# ----------------------------------------
byElevationAndName = Level.ByElevationAndName(elevation=designscript_count_floorheight.out5, name=designscript_count_floorheight.out6)
count = List.Count(list=byElevationAndName)

# group: OUTPUTS
# Review the created Level elements and confirm the count equals 52.
watch_created_levels = Watch(byElevationAndName)  # graph output
watch_level_count = Watch(count)  # graph output
