# Dynamo graph CreateRevitLevels.dyn (Dynamo 2.19.0.0)
# Creates Revit Levels from names and elevations defined inside a single DesignScript code block.

# note: 1  Edit lines 1-2 in the code block (names + elevations)
# 2  Click Run  -  levels appear in Revit immediately
create_revit_levels = CodeBlock()  # graph input
# ---------- create_revit_levels.designscript (4 lines) ----------
names         = ["SRLMB - GF", "SRLMB - L1", "SRLMB - L2", "SRLMB - L3", "SRLMB - Roof"];
elevations_mm = [0, 3000, 6000, 9000, 12000];
levels        = Revit.Elements.Level.ByElevation(elevations_mm);
named         = levels.SetParameterByName("Name", names);
# ----------------------------------------
result = Watch(create_revit_levels.named)
